# Grasshopper definition 00-invisibledragon-material-construction.gh (Grasshopper 1.0.7)
# plug-ins: InvisibleDragon

# ---- group: 1. Material Inputs
# InvisibleDragon starter: choose an opaque material.
# Set its layer thickness.
mat = OpaqueMaterial(Name="Opaque Material", Conductivity=0.5, Density=800, SpecificHeat=1000)
thickness_m = Slider(0.1, range=0.01..1)

# ---- group: 2. Construction Assembly
# Combine material and thickness into a layer.
# Add the layer to the construction.
layer = ConstructionLayer(Material=mat, Thickness=thickness_m)
con = LayeredConstruction(Name="Layered Construction", Layers=layer)  # -> Construction, UValue

# ---- group: 3. Calculated Result
# Read the calculated U-value.
u_value = Panel(con.UValue)
