# Grasshopper definition 02-invisibledragon-single-zone-hvac-idf.gh (Grasshopper 1.0.7)
# plug-ins: InvisibleDragon

prepare_runtime_explicit_rising_edge = Boolean(False)
prepare_missing_runtime_during_run = Boolean(False)
repair_invalid_custom_target = Boolean(False)
cancel_runtime_preparation = Boolean(False)
run_explicit_rising_edge = Boolean(False)
south_wall_boundary = Curve(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)
north_wall_boundary = Curve(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)
west_wall_boundary = Curve(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)
keep_work_directory = Boolean(True)
east_wall_boundary = Curve(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)
cancel_active_run = Boolean(False)
floor_boundary = Curve(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)
roof_boundary = Curve(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)
force_rerun = Boolean(False)
mat = OpaqueMaterial(Name="Opaque Material", Conductivity=0.5, Density=800, SpecificHeat=1000)
envelope_0_200_m = Slider(0.2, range=0.01..0.5)
con = LayeredConstruction(Name="Layered Construction", Materials=mat, Thicknesses=envelope_0_200_m)  # -> Construction, UValue
prof = ConstantProfile(Name="Basic Profile", HeatingSetpoint=20, CoolingSetpoint=26, Occupancy=0)  # -> Profile, Diagnostics
floor_name = Panel("Floor")
roof_name = Panel("Roof")
south_wall_name = Panel("South Wall")
surf = SurfaceFromPolyline(
    Boundary=south_wall_boundary,
    Name=south_wall_name,
    Type="Wall",
    Construction=con.Construction,
    BoundaryCondition="Outdoors")  # -> Surface, GrossArea, Diagnostics
north_wall_name = Panel("North Wall")
surf_2 = SurfaceFromPolyline(
    Boundary=north_wall_boundary,
    Name=north_wall_name,
    Type="Wall",
    Construction=con.Construction,
    BoundaryCondition="Outdoors")  # -> Surface, GrossArea, Diagnostics
west_wall_name = Panel("West Wall")
surf_3 = SurfaceFromPolyline(
    Boundary=west_wall_boundary,
    Name=west_wall_name,
    Type="Wall",
    Construction=con.Construction,
    BoundaryCondition="Outdoors")  # -> Surface, GrossArea, Diagnostics
east_wall_name = Panel("East Wall")
surf_4 = SurfaceFromPolyline(
    Boundary=east_wall_boundary,
    Name=east_wall_name,
    Type="Wall",
    Construction=con.Construction,
    BoundaryCondition="Outdoors")  # -> Surface, GrossArea, Diagnostics
floor_type = Panel("Floor")
ceiling_type = Panel("Ceiling")
surf_5 = SurfaceFromPolyline(Boundary=roof_boundary, Name=roof_name, Type=ceiling_type, Construction=con.Construction, BoundaryCondition="Outdoors")  # -> Surface, GrossArea, Diagnostics
ground_boundary = Panel("Ground")
surf_6 = SurfaceFromPolyline(
    Boundary=floor_boundary,
    Name=floor_name,
    Type=floor_type,
    Construction=con.Construction,
    BoundaryCondition=ground_boundary)  # -> Surface, GrossArea, Diagnostics
zone = ThermalZone(
    Name="Zone",
    Surfaces=[surf_6.Surface, surf_5.Surface, surf.Surface, surf_2.Surface, surf_3.Surface, surf_4.Surface],
    Profile=prof.Profile,
    Infiltration=0,
    LightingPowerDensity=0,
    OutdoorAirFlow=0)  # -> Zone, Valid, Diagnostics
heatpump = HeatPump(Name="Heat Pump", Fuel=0, HeatingCOP=3.5, CoolingCOP=4, HeatingCapacity=0, CoolingCapacity=0)
ahu = AirHandlingUnit(Name="Air Handling Unit", HeatPump=heatpump, FanTotalEfficiency=0.7, FanPressureRise=100, MotorEfficiency=0.9)
boiler = Boiler(Name="Boiler", Fuel=1, ThermalEfficiency=0.9, NominalCapacity=0, PumpMotorEfficiency=0.9, HotWaterSetpoint=60)
radiantfloor = RadiantFloor(Name="Radiant Floor", HydronicSource=boiler, ThrottlingRange=2)
erv = EnergyRecoveryVentilator(
    Name="Energy Recovery Ventilator",
    SensibleEffectiveness=0.75,
    LatentEffectiveness=0.65,
    SupplyAirFlow=0,
    FanTotalEfficiency=0.7,
    FanPressureRise=100)
pv = PhotovoltaicPanel(Name="Photovoltaic Panel", Area=10, Tilt=30, Azimuth=180, Efficiency=0.2, ActiveCellAreaFraction=0.7)
model = EnergyModel(
    Name="InvisibleDragon Model",
    Zones=zone.Zone,
    NorthAxis=0,
    Terrain="Suburbs",
    Sources=[heatpump, boiler],
    SupplySystems=[ahu, radiantfloor],
    Ventilators=erv,
    PVPanels=pv)  # -> Model, Valid, Diagnostics
idf = CompileIDF(Model=model.Model)  # -> IDF, Text, Valid, Diagnostics
valid = ValidateIDF(IDF=idf.IDF)  # -> Valid, Diagnostics
compiled_idf = Panel(idf.Text)
idd_validation = Panel(valid.Valid)
runtime_target_root_optional = Panel("")
runtime_lock_timeout_2_min = Slider(2, range=1..30)
prepare_e = PrepareEnergyPlusRuntime(
    TargetRoot=runtime_target_root_optional,
    Prepare=prepare_runtime_explicit_rising_edge,
    Cancel=cancel_runtime_preparation,
    ReplaceInvalidCustomTarget=repair_invalid_custom_target,
    LockTimeout=runtime_lock_timeout_2_min)  # -> RuntimeRoot, Executable, State, Ready, Progress, Message, Diagnostics
runtime_preparation_state = Panel(prepare_e.State)
runtime_ready = Panel(prepare_e.Ready)
runtime_preparation_message = Panel(prepare_e.Message)
epw_path_choose_a_local_weather_file = Panel("")
run_temp_root_optional = Panel("")
run_timeout_30_min = Slider(30, range=1..60)
run = RunEnergyPlus(
    IDF=idf.IDF,
    Weather=epw_path_choose_a_local_weather_file,
    RuntimeRoot=prepare_e.RuntimeRoot,
    TempRoot=run_temp_root_optional,
    Run=run_explicit_rising_edge,
    Cancel=cancel_active_run,
    ForceRerun=force_rerun,
    KeepWorkDirectory=keep_work_directory,
    Timeout=run_timeout_30_min,
    PrepareMissingRuntime=prepare_missing_runtime_during_run)  # -> Result, State, Success, WorkDirectory, Diagnostics
energyplus_state = Panel(run.State)
energyplus_success = Panel(run.Success)
energyplus_work_directory = Panel(run.WorkDirectory)
sum = EnergyPlusResultSummary(Result=run.Result)  # -> RunID, State, Success, Warnings, Severe, Fatal, Elapsed, MonthlyTables, WorkDirectory, Diagnostics
result_run_id = Panel(sum.RunID)
result_state = Panel(sum.State)
result_success = Panel(sum.Success)
result_warning_count = Panel(sum.Warnings)
result_severe_count = Panel(sum.Severe)
result_fatal_count = Panel(sum.Fatal)
result_elapsed_seconds = Panel(sum.Elapsed)
result_monthly_tables = Panel(sum.MonthlyTables)
result_work_directory = Panel(sum.WorkDirectory)
