# Grasshopper definition 10-simpledragon-material-construction.gh (Grasshopper 1.0.7)
# plug-ins: SimpleDragon

# ---- group: 1. Material Inputs
# SimpleDragon starter: choose an opaque material.
# Set its layer thickness.
sd_material = SimpleDragonMaterial(Name="Simple Material", Conductivity=0.04, Density=30, SpecificHeat=1400)
thickness_m = Slider(0.1, range=0.01..1)

# ---- group: 2. Construction Assembly
# Combine material and thickness into a layer.
# Add the layer to the construction.
sd_layer = SimpleDragonConstructionLayer(Material=sd_material, Thickness=thickness_m)
sd_construction = SimpleDragonSurfaceConstruction(Name="Simple Construction", Layers=sd_layer)  # -> Construction, UValue

# ---- group: 3. Calculated Result
# Read the calculated U-value.
u_value = Panel(sd_construction.UValue)
