# Grasshopper definition 12-simpledragon-two-zone-model.gh (Grasshopper 1.0.7)
# plug-ins: SimpleDragon

# ---- group: 1 Rhino source and shared definitions
# Open 30-two-zone-office.3dm; relink each named face Brep and
# window to its matching local Surface cluster.
# Shared construction, fenestration and office-profile
# definitions feed both zone lanes.
sd_material = SimpleDragonMaterial(Name="Simple Material", Conductivity=0.04, Density=30, SpecificHeat=1400)
envelope_0_200_m = Slider(0.2, range=0.01..0.5)
sd_layer = SimpleDragonConstructionLayer(Material=sd_material, Thickness=envelope_0_200_m)
sd_construction = SimpleDragonSurfaceConstruction(Name="Simple Construction", Layers=sd_layer)  # -> Construction, UValue
packaged_office_profile = Panel("소규모사무실")
sd_fenestration = SimpleDragonFenestrationConstruction(Name="Simple Window", UValue=1.5, SHGC=0.5)  # -> Construction, Transparent
sd_profile = LookupSimpleDragonUsageProfile(Name=packaged_office_profile)  # -> Profile, AvailableNames, Diagnostics

# ---- group: 2 West zone envelope
# West envelope: lists author repeated walls; the south wall
# owns its opening.
zone_01_west_plain_walls_list = Brep([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])
window_zone_01_south = Curve(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)
zone_01_west_ceiling = Brep(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)
zone_01_west_floor = Brep(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)
zone_01_west_south = Brep(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)
zone_01_west_plain_wall_names_list = Text(["ZONE_01_WEST_NORTH", "ZONE_01_WEST_WEST", "ZONE_01_WEST_EAST"])
zone_01_west_floor_name = Panel("ZONE_01_WEST_FLOOR")
zone_01_west_ceiling_name = Panel("ZONE_01_WEST_CEILING")
zone_01_west_south_name = Panel("ZONE_01_WEST_SOUTH")
zone_01_west_floor_boundary = ValueList({"Outdoors", "Ground", "Adiabatic"}, selected="Ground")
sd_opening = SimpleDragonOpening(Boundary=window_zone_01_south, Name="Opening", Type="Window", Construction=sd_fenestration.Construction, Blind="None")  # -> Opening, Diagnostics
sd_ceiling = SimpleDragonCeiling(
    Face=zone_01_west_ceiling,
    Name=zone_01_west_ceiling_name,
    Construction=sd_construction.Construction,
    BoundaryCondition="Outdoors")  # -> Surface, Diagnostics
sd_floor = SimpleDragonFloor(
    Face=zone_01_west_floor,
    Name=zone_01_west_floor_name,
    Construction=sd_construction.Construction,
    BoundaryCondition=zone_01_west_floor_boundary)  # -> Surface, Diagnostics
sd_wall = SimpleDragonWall(
    Face=zone_01_west_plain_walls_list,
    Name=zone_01_west_plain_wall_names_list,
    Construction=sd_construction.Construction,
    BoundaryCondition="Outdoors")  # -> Surface, Diagnostics
sd_wall_2 = SimpleDragonWall(
    Face=zone_01_west_south,
    Name=zone_01_west_south_name,
    Construction=sd_construction.Construction,
    BoundaryCondition="Outdoors",
    Openings=sd_opening.Opening)  # -> Surface, Diagnostics

# ---- group: 4 East zone envelope
# East envelope: lists author repeated walls; the south wall
# owns its opening.
zone_02_east_plain_walls_list = Brep([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])
window_zone_02_south = Curve(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)
zone_02_east_ceiling = Brep(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)
zone_02_east_south = Brep(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)
zone_02_east_floor = Brep(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)
zone_02_east_plain_wall_names_list = Text(["ZONE_02_EAST_NORTH", "ZONE_02_EAST_WEST", "ZONE_02_EAST_EAST"])
zone_02_east_floor_name = Panel("ZONE_02_EAST_FLOOR")
zone_02_east_ceiling_name = Panel("ZONE_02_EAST_CEILING")
zone_02_east_south_name = Panel("ZONE_02_EAST_SOUTH")
zone_02_east_floor_boundary = ValueList({"Outdoors", "Ground", "Adiabatic"}, selected="Ground")
sd_opening_2 = SimpleDragonOpening(Boundary=window_zone_02_south, Name="Opening", Type="Window", Construction=sd_fenestration.Construction, Blind="None")  # -> Opening, Diagnostics
sd_ceiling_2 = SimpleDragonCeiling(
    Face=zone_02_east_ceiling,
    Name=zone_02_east_ceiling_name,
    Construction=sd_construction.Construction,
    BoundaryCondition="Outdoors")  # -> Surface, Diagnostics
sd_floor_2 = SimpleDragonFloor(
    Face=zone_02_east_floor,
    Name=zone_02_east_floor_name,
    Construction=sd_construction.Construction,
    BoundaryCondition=zone_02_east_floor_boundary)  # -> Surface, Diagnostics
sd_wall_3 = SimpleDragonWall(
    Face=zone_02_east_plain_walls_list,
    Name=zone_02_east_plain_wall_names_list,
    Construction=sd_construction.Construction,
    BoundaryCondition="Outdoors")  # -> Surface, Diagnostics
sd_wall_4 = SimpleDragonWall(
    Face=zone_02_east_south,
    Name=zone_02_east_south_name,
    Construction=sd_construction.Construction,
    BoundaryCondition="Outdoors",
    Openings=sd_opening_2.Opening)  # -> Surface, Diagnostics

# ---- group: 3 West systems and zone
# West zone: attach HVAC and ERV directly after collecting the
# west surface list.
west_zone_height_3_200_m = Slider(3.2, range=0.1..20)
sd_heat_pump = SimpleDragonHeatPump(Name="Heat Pump", Fuel="Electricity", HeatingCOP=3, CoolingCOP=3)  # -> Source, Diagnostics
west_zone_hvac = Panel("West Zone HVAC")
west_zone_erv = Panel("West Zone ERV")
west_zone_name = Panel("West Office Zone")
sd_ahu = SimpleDragonAirHandlingUnit(Name=west_zone_hvac, Source=sd_heat_pump.Source)  # -> Supply, Diagnostics
sd_erv = SimpleDragonEnergyRecoveryVentilator(Name=west_zone_erv, Airflow=0.2, HeatingEfficiency=0.7, CoolingEfficiency=0.45, Count=1)  # -> ZoneERV, Diagnostics
sd_zone = SimpleDragonZone(
    Surfaces=[sd_floor.Surface, sd_ceiling.Surface, sd_wall.Surface, sd_wall_2.Surface],
    Name=west_zone_name,
    FloorNumber=0,
    Height=west_zone_height_3_200_m,
    Profile=sd_profile.Profile,
    HVAC=sd_ahu.Supply,
    ERVs=sd_erv.ZoneERV,
    LightingPowerDensity=10)  # -> Zone, Diagnostics

# ---- group: 5 East systems and zone
# East zone: the parallel lane repeats the same ownership
# pattern without index matching.
east_zone_height_3_200_m = Slider(3.2, range=0.1..20)
sd_boiler = SimpleDragonBoiler(Name="Boiler", Fuel="NaturalGas", Efficiency=0.85, HotWaterSupply=False)  # -> Source, Diagnostics
east_zone_hvac = Panel("East Zone HVAC")
east_zone_erv = Panel("East Zone ERV")
east_zone_name = Panel("East Office Zone")
sd_radiator = SimpleDragonRadiator(Name=east_zone_hvac, Source=sd_boiler.Source)  # -> Supply, Diagnostics
sd_erv_2 = SimpleDragonEnergyRecoveryVentilator(Name=east_zone_erv, Airflow=0.2, HeatingEfficiency=0.7, CoolingEfficiency=0.45, Count=1)  # -> ZoneERV, Diagnostics
sd_zone_2 = SimpleDragonZone(
    Surfaces=[sd_floor_2.Surface, sd_ceiling_2.Surface, sd_wall_3.Surface, sd_wall_4.Surface],
    Name=east_zone_name,
    FloorNumber=0,
    Height=east_zone_height_3_200_m,
    Profile=sd_profile.Profile,
    HVAC=sd_radiator.Supply,
    ERVs=sd_erv_2.ZoneERV,
    LightingPowerDensity=10)  # -> Zone, Diagnostics

# ---- group: 6 Two-zone model and inspection
# Collect both zone objects into one model; use Model Summary
# for derived properties, then inspect GRM JSON and diagnostics.
sd_pv = SimpleDragonPhotovoltaicPanel(Name="Photovoltaic Panel", Area=10, Efficiency=0.2, Azimuth=180, Tilt=30)  # -> PV, Diagnostics
model_name = Panel("Two-Zone Office")
sd_model = SimpleDragonModel(
    Name=model_name,
    Zones=[sd_zone.Zone, sd_zone_2.Zone],
    NorthAxis=0,
    Address="서울특별시 종로구",
    Vintage="2020-01-01",
    MultifamilyHousing=False,
    PhotovoltaicPanels=sd_pv.PV)  # -> GRM, Zones, Surfaces, JSON, Diagnostics
sd_model_summary = SimpleDragonModelSummary(GRM=sd_model.GRM)  # -> FloorArea, ExteriorFloors, ExteriorRoofs, ExteriorWalls, ExteriorWindows, AverageExteriorFloorUValue, AverageExteriorRoofUValue, AverageExteriorWallUValue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
total_floor_area = Panel(sd_model_summary.FloorArea)
complete_grm_json = Panel(sd_model.JSON)
model_diagnostics = Panel(sd_model.Diagnostics)
