# Grasshopper definition 12-simpledragon-two-zone-to-idf.gh (Grasshopper 1.0.7)
# plug-ins: SimpleDragon

zone_01_west_ceiling_type_ceiling = Integer(1)
zone_02_east_ceiling_type_ceiling = Integer(1)
zone_01_west_floor_type_floor = Integer(2)
zone_01_west_ceiling_boundary = Integer(0)
zone_01_west_north_type_wall = Integer(0)
zone_01_west_south_type_wall = Integer(0)
zone_01_west_north_boundary = Integer(0)
zone_01_west_south_boundary = Integer(0)
zone_02_east_floor_type_floor = Integer(2)
zone_02_east_ceiling_boundary = Integer(0)
zone_02_east_north_type_wall = Integer(0)
zone_01_west_floor_boundary = Integer(1)
zone_02_east_south_type_wall = Integer(0)
zone_02_east_north_boundary = Integer(0)
zone_02_east_floor_boundary = Integer(1)
zone_02_east_south_boundary = Integer(0)
zone_01_west_west_type_wall = Integer(0)
zone_01_west_west_boundary = Integer(0)
zone_01_west_east_type_wall = Integer(0)
zone_02_east_west_type_wall = Integer(0)
zone_01_west_east_boundary = Integer(0)
zone_02_east_west_boundary = Integer(0)
zone_02_east_east_type_wall = Integer(0)
zone_02_east_east_boundary = Integer(0)
window_zone_01_south = Curve(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)
window_zone_02_south = Curve(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)
zone_01_west_ceiling = Brep(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)
zone_01_west_north = Brep(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)
zone_02_east_ceiling = Brep(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)
zone_01_west_floor = Brep(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)
zone_01_west_south = Brep(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)
zone_02_east_south = Brep(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)
zone_02_east_north = Brep(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)
zone_02_east_floor = Brep(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)
zone_01_west_west = Brep(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)
zone_01_west_east = Brep(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)
zone_02_east_west = Brep(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)
zone_02_east_east = Brep(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)
# Rhino source model: Open 30-two-zone-office.3dm; relink each named face Brep and window to its matching local Surface cluster.
packaged_office_profile = Panel("소규모사무실")
sd_profile = LookupSimpleDragonUsageProfile(Name=packaged_office_profile)  # -> Profile, AvailableNames, Diagnostics
sd_material = SimpleDragonMaterial(Name="Simple Material", Conductivity=0.04, Density=30, SpecificHeat=1400)
envelope_0_200_m = Slider(0.2, range=0.01..0.5)
sd_layer = SimpleDragonConstructionLayer(Material=sd_material, Thickness=envelope_0_200_m)
sd_construction = SimpleDragonSurfaceConstruction(Name="Simple Construction", Layers=sd_layer)  # -> Construction, UValue
sd_fenestration = SimpleDragonFenestrationConstruction(Name="Simple Window", UValue=1.5, SHGC=0.5)  # -> Construction, Transparent
sd_opening = SimpleDragonOpening(Boundary=window_zone_01_south, Name="Opening", Type=0, Construction=sd_fenestration.Construction, Blind="None")  # -> Opening, Diagnostics
sd_opening_2 = SimpleDragonOpening(Boundary=window_zone_02_south, Name="Opening", Type=0, Construction=sd_fenestration.Construction, Blind="None")  # -> Opening, Diagnostics
zone_01_west_floor_name = Panel("ZONE_01_WEST_FLOOR")
sd_surface = SimpleDragonSurface(
    Face=zone_01_west_floor,
    Name=zone_01_west_floor_name,
    Type=zone_01_west_floor_type_floor,
    Construction=sd_construction.Construction,
    BoundaryIntent=zone_01_west_floor_boundary)  # -> Surface, Diagnostics
zone_01_west_ceiling_name = Panel("ZONE_01_WEST_CEILING")
sd_surface_2 = SimpleDragonSurface(
    Face=zone_01_west_ceiling,
    Name=zone_01_west_ceiling_name,
    Type=zone_01_west_ceiling_type_ceiling,
    Construction=sd_construction.Construction,
    BoundaryIntent=zone_01_west_ceiling_boundary)  # -> Surface, Diagnostics
zone_01_west_south_name = Panel("ZONE_01_WEST_SOUTH")
sd_surface_3 = SimpleDragonSurface(
    Face=zone_01_west_south,
    Name=zone_01_west_south_name,
    Type=zone_01_west_south_type_wall,
    Construction=sd_construction.Construction,
    BoundaryIntent=zone_01_west_south_boundary,
    Openings=sd_opening.Opening)  # -> Surface, Diagnostics
zone_01_west_north_name = Panel("ZONE_01_WEST_NORTH")
sd_surface_4 = SimpleDragonSurface(
    Face=zone_01_west_north,
    Name=zone_01_west_north_name,
    Type=zone_01_west_north_type_wall,
    Construction=sd_construction.Construction,
    BoundaryIntent=zone_01_west_north_boundary)  # -> Surface, Diagnostics
zone_01_west_west_name = Panel("ZONE_01_WEST_WEST")
sd_surface_5 = SimpleDragonSurface(
    Face=zone_01_west_west,
    Name=zone_01_west_west_name,
    Type=zone_01_west_west_type_wall,
    Construction=sd_construction.Construction,
    BoundaryIntent=zone_01_west_west_boundary)  # -> Surface, Diagnostics
zone_01_west_east_name = Panel("ZONE_01_WEST_EAST")
sd_surface_6 = SimpleDragonSurface(
    Face=zone_01_west_east,
    Name=zone_01_west_east_name,
    Type=zone_01_west_east_type_wall,
    Construction=sd_construction.Construction,
    BoundaryIntent=zone_01_west_east_boundary)  # -> Surface, Diagnostics
zone_02_east_floor_name = Panel("ZONE_02_EAST_FLOOR")
sd_surface_7 = SimpleDragonSurface(
    Face=zone_02_east_floor,
    Name=zone_02_east_floor_name,
    Type=zone_02_east_floor_type_floor,
    Construction=sd_construction.Construction,
    BoundaryIntent=zone_02_east_floor_boundary)  # -> Surface, Diagnostics
zone_02_east_ceiling_name = Panel("ZONE_02_EAST_CEILING")
sd_surface_8 = SimpleDragonSurface(
    Face=zone_02_east_ceiling,
    Name=zone_02_east_ceiling_name,
    Type=zone_02_east_ceiling_type_ceiling,
    Construction=sd_construction.Construction,
    BoundaryIntent=zone_02_east_ceiling_boundary)  # -> Surface, Diagnostics
zone_02_east_south_name = Panel("ZONE_02_EAST_SOUTH")
sd_surface_9 = SimpleDragonSurface(
    Face=zone_02_east_south,
    Name=zone_02_east_south_name,
    Type=zone_02_east_south_type_wall,
    Construction=sd_construction.Construction,
    BoundaryIntent=zone_02_east_south_boundary,
    Openings=sd_opening_2.Opening)  # -> Surface, Diagnostics
zone_02_east_north_name = Panel("ZONE_02_EAST_NORTH")
sd_surface_10 = SimpleDragonSurface(
    Face=zone_02_east_north,
    Name=zone_02_east_north_name,
    Type=zone_02_east_north_type_wall,
    Construction=sd_construction.Construction,
    BoundaryIntent=zone_02_east_north_boundary)  # -> Surface, Diagnostics
zone_02_east_west_name = Panel("ZONE_02_EAST_WEST")
sd_surface_11 = SimpleDragonSurface(
    Face=zone_02_east_west,
    Name=zone_02_east_west_name,
    Type=zone_02_east_west_type_wall,
    Construction=sd_construction.Construction,
    BoundaryIntent=zone_02_east_west_boundary)  # -> Surface, Diagnostics
zone_02_east_east_name = Panel("ZONE_02_EAST_EAST")
sd_surface_12 = SimpleDragonSurface(
    Face=zone_02_east_east,
    Name=zone_02_east_east_name,
    Type=zone_02_east_east_type_wall,
    Construction=sd_construction.Construction,
    BoundaryIntent=zone_02_east_east_boundary)  # -> Surface, Diagnostics
sd_heat_pump = SimpleDragonHeatPump(Name="Heat Pump", Fuel=0, HeatingCOP=3, CoolingCOP=3)  # -> Source, Diagnostics
sd_boiler = SimpleDragonBoiler(Name="Boiler", Fuel=1, Efficiency=0.85, HotWaterSupply=False)  # -> Source, Diagnostics
sd_pv = SimpleDragonPhotovoltaicPanel(Name="Photovoltaic Panel", Area=10, Efficiency=0.2, Azimuth=180, Tilt=30)  # -> PV, Diagnostics
west_zone_hvac = Panel("West Zone HVAC")
sd_ahu = SimpleDragonAirHandlingUnit(Name=west_zone_hvac, Source=sd_heat_pump.Source)  # -> Supply, Diagnostics
east_zone_hvac = Panel("East Zone HVAC")
sd_radiator = SimpleDragonRadiator(Name=east_zone_hvac, Source=sd_boiler.Source)  # -> Supply, Diagnostics
west_zone_erv = Panel("West Zone ERV")
sd_erv = SimpleDragonEnergyRecoveryVentilator(Name=west_zone_erv, Airflow=0.2, HeatingEfficiency=0.7, CoolingEfficiency=0.45, Count=1)  # -> ZoneERV, Diagnostics
east_zone_erv = Panel("East Zone ERV")
sd_erv_2 = SimpleDragonEnergyRecoveryVentilator(Name=east_zone_erv, Airflow=0.2, HeatingEfficiency=0.7, CoolingEfficiency=0.45, Count=1)  # -> ZoneERV, Diagnostics
west_zone_name = Panel("West Office Zone")
east_zone_name = Panel("East Office Zone")
west_zone_height_3_200_m = Slider(3.2, range=0.1..20)
sd_zone = SimpleDragonZone(
    Surfaces=[sd_surface.Surface, sd_surface_2.Surface, sd_surface_3.Surface, sd_surface_4.Surface, sd_surface_5.Surface, sd_surface_6.Surface],
    Name=west_zone_name,
    FloorNumber=0,
    Height=west_zone_height_3_200_m,
    Profile=sd_profile.Profile,
    HVAC=sd_ahu.Supply,
    ERVs=sd_erv.ZoneERV,
    LightingPowerDensity=10)  # -> Zone, Diagnostics
east_zone_height_3_200_m = Slider(3.2, range=0.1..20)
sd_zone_2 = SimpleDragonZone(
    Surfaces=[sd_surface_7.Surface, sd_surface_8.Surface, sd_surface_9.Surface, sd_surface_10.Surface, sd_surface_11.Surface, sd_surface_12.Surface],
    Name=east_zone_name,
    FloorNumber=0,
    Height=east_zone_height_3_200_m,
    Profile=sd_profile.Profile,
    HVAC=sd_radiator.Supply,
    ERVs=sd_erv_2.ZoneERV,
    LightingPowerDensity=10)  # -> Zone, Diagnostics
model_name = Panel("Two-Zone Office")
sd_model = SimpleDragonModel(
    Name=model_name,
    Zones=[sd_zone.Zone, sd_zone_2.Zone],
    NorthAxis=0,
    Address="서울특별시 종로구",
    Vintage="2020-01-01",
    MultifamilyHousing=False,
    PhotovoltaicPanels=sd_pv.PV)  # -> GRM, Zones, Surfaces, GeometryMap, GeometryMapData, JSON, FloorArea, Diagnostics
sd_to_idf = PrepareSimpleDragonSimulation(GRM=sd_model.GRM)  # -> EnergyModel, IDF, Weather, Success, Diagnostics
geometry_provenance_map = Panel(sd_model.GeometryMap)
total_floor_area = Panel(sd_model.FloorArea)
prepared_idf = Panel(sd_to_idf.IDF)
verified_packaged_weather = Panel(sd_to_idf.Weather)
preparation_success = Panel(sd_to_idf.Success)
